# Grasshopper definition DendroMeshUnion_PF.gh (Grasshopper 1.0.7)
# plug-ins: Speckle 2, DendroGH

mesh = Mesh([<mesh referenced from the Rhino model> x1199])
vsettings = CreateSettings(VoxelSize=1, Bandwidth=1, Isovalue=0, Adaptivity=0.1)  # disabled
mesh_2 = Mesh([<mesh referenced from the Rhino model> x1199])  # disabled
panel = Panel("https://speckle.xyz/streams/724b722d6e")  # disabled
capex = CapHolesEx(Brep=mesh)  # -> Brep, Caps, Solid
vsettings_2 = VolumeSettings()  # disabled
medges = MeshEdges(Mesh=mesh_2)  # -> NakedEdges, InteriorEdges, NonManifoldEdges; disabled
panel_2 = Panel("0")  # disabled
mesh_3 = Mesh([<mesh referenced from the Rhino model> x5])
send = Send(AutoSend=False, CurrentComponentState="needs_input", KitName="Objects", UseDefaultCache=True, selectedKitName="Objects")  # disabled
lng = ListLength(List=medges.NonManifoldEdges)  # disabled
lng_2 = ListLength(List=medges.NakedEdges)  # disabled
lng_3 = ListLength(List=medges.InteriorEdges)  # disabled
bbox = BoundingBox(Content=mesh_3, Plane=PlaneXY(0, 0, 0), UnionBox=True)  # -> Box, Box_2
vmesh = MeshToVolume(Mesh=mesh_2, Settings=vsettings)  # disabled
receive = Receive(
    Stream=panel,
    AutoReceive=False,
    CurrentComponentState="expired",
    ExpandOutput=True,
    ReceiveOnOpen=False,
    StreamWrapper="https://speckle.xyz/streams/724b722d6e",
    selectedKitName="Objects")  # -> Info, Data; disabled
volume = Volume(Geometry=bbox.Box)  # -> Volume, Centroid
larger = LargerThan(FirstNumber=lng_2, SecondNumber=panel_2)  # -> LargerThan, OrEqualTo; disabled
larger_2 = LargerThan(FirstNumber=lng_3, SecondNumber=panel_2)  # -> LargerThan, OrEqualTo; disabled
larger_3 = LargerThan(FirstNumber=lng, SecondNumber=panel_2)  # -> LargerThan, OrEqualTo; disabled
vunion = VolumeUnion(Volumes=vmesh)  # disabled
msphere = MeshSphere(Base=volume.Centroid, Radius=10, UCount=10, VCount=20)
multiplication = Multiplication()  # disabled
mcol = MeshColours(
    Mesh=graft(mesh_3),
    Colours=[RGB(127, 255, 0), RGB(0, 100, 0), RGB(34, 139, 34), RGB(124, 252, 0), RGB(154, 205, 50), RGB(173, 255, 47), RGB(50, 205, 50), RGB(152, 251, 152)])
facen = FaceNormals(Mesh=msphere)  # -> Centers, Normals
exposure = Exposure(Shape=mesh_3, Rays=facen.Normals, Lambert=False)  # -> Exposure, Range
addition = Addition(A=larger.LargerThan, B=larger_3.LargerThan)  # disabled
panel_3 = Panel(addition)  # disabled
panel_4 = Panel(exposure.Exposure)
cull = CullPattern(List=mesh_2, CullPattern=invert(flatten(addition)))  # disabled
