# Grasshopper definition GH_MeshOffset_02_PF - Copy.gh (Grasshopper 1.0.7)
# plug-ins: Speckle 2, DendroGH, Pufferfish

mesh = Mesh([<mesh referenced from the Rhino model> x1802])
explode = ExplodeObject(Object=mesh, Recursive=False)
send = Send(AutoSend=False, CurrentComponentState="needs_input", KitName="Objects", UseDefaultCache=True, selectedKitName="Objects")  # disabled
mm = Panel("0.1")
wrap = ShrinkWrap(Geometry=mesh, EdgeLength=mm, Offset=0, Smoothing=0, Optimization=10, FillHoles=True)
receive = Receive(
    Stream=<missing>,
    AutoReceive=False,
    CurrentComponentState="expired",
    ExpandOutput=True,
    ReceiveOnOpen=False,
    StreamWrapper="https://speckle.xyz/streams/724b722d6e",
    selectedKitName="Objects")  # -> Info, Data; disabled
mesh_2 = Mesh(<mesh referenced from the Rhino model>)  # disabled
mesh_3 = Mesh([<mesh referenced from the Rhino model> x1774])  # disabled
mesh_4 = Mesh([<mesh referenced from the Rhino model> x1199])  # disabled
vsettings = CreateSettings(VoxelSize=1, Bandwidth=1, Isovalue=0, Adaptivity=0.1)  # disabled
medges = MeshEdges(Mesh=mesh_2)  # -> NakedEdges, InteriorEdges, NonManifoldEdges; disabled
mesh_5 = Mesh([<mesh referenced from the Rhino model> x1199])  # disabled
disjoint = DisjointMesh(Mesh=wrap)
panel = Panel("https://speckle.xyz/streams/724b722d6e")  # disabled
capex = CapHolesEx(Brep=mesh_4)  # -> Brep, Caps, Solid; disabled
panel_2 = Panel("0.1")  # disabled
vsettings_2 = VolumeSettings()  # disabled
crv = Curve(medges.NakedEdges)  # disabled
medges_2 = MeshEdges(Mesh=mesh_5)  # -> NakedEdges, InteriorEdges, NonManifoldEdges; disabled
area = Area(Geometry=disjoint)  # -> Area, Centroid
area_2 = Area(Geometry=mesh_3)  # -> Area, Centroid; disabled
panel_3 = Panel("0")  # disabled
wrap_2 = ShrinkWrap(Geometry=mesh_2, EdgeLength=panel_2, Offset=0, Smoothing=0, Optimization=10, FillHoles=True)  # disabled
vsettings_3 = CreateSettings(VoxelSize=0.2, Bandwidth=1, Isovalue=0, Adaptivity=0.1)  # disabled
mesh_6 = Mesh([<mesh referenced from the Rhino model> x5])  # disabled
sort = SortList(Keys=area.Area, ValuesA=disjoint)  # -> Keys, ValuesA
disjoint_2 = DisjointMesh(Mesh=wrap_2)  # disabled
panel_4 = Panel("0.5")  # disabled
panel_5 = Panel("0.6")  # disabled
lng = ListLength(List=medges_2.NonManifoldEdges)  # disabled
lng_2 = ListLength(List=medges_2.NakedEdges)  # disabled
rev = ReverseList(List=sort.ValuesA)
lng_3 = ListLength(List=medges_2.InteriorEdges)  # disabled
bbox = BoundingBox(Content=mesh_6, Plane=PlaneXY(0, 0, 0), UnionBox=True)  # -> Box, Box_2; disabled
area_3 = Area(Geometry=disjoint_2)  # -> Area, Centroid; disabled
vmesh = MeshToVolume(Mesh=wrap_2, Settings=vsettings_3)  # disabled
item = ListItem(List=rev, Index=0, Wrap=True)
vmesh_2 = MeshToVolume(Mesh=mesh_5, Settings=vsettings)  # disabled
volume = Volume(Geometry=bbox.Box)  # -> Volume, Centroid; disabled
voffset = OffsetVolume(Volume=vmesh, Distance=expr("-x", panel_4))  # disabled
sort_2 = SortList(Keys=area_3.Area, ValuesA=disjoint_2)  # -> Keys, ValuesA; disabled
larger = LargerThan(FirstNumber=lng_2, SecondNumber=panel_3)  # -> LargerThan, OrEqualTo; disabled
larger_2 = LargerThan(FirstNumber=lng_3, SecondNumber=panel_3)  # -> LargerThan, OrEqualTo; disabled
larger_3 = LargerThan(FirstNumber=lng, SecondNumber=panel_3)  # -> LargerThan, OrEqualTo; disabled
addition = Addition(A=panel_4, B=panel_5)  # disabled
vunion = VolumeUnion(Volumes=vmesh_2)  # disabled
vsettings_4 = CreateSettings(VoxelSize=0.2, Bandwidth=1, Isovalue=0, Adaptivity=0.1)
rev_2 = ReverseList(List=sort_2.ValuesA)  # disabled
mm_2 = Panel(".6")
mm_3 = Panel(".5")
voffset_2 = OffsetVolume(Volume=voffset, Distance=addition)  # disabled
msphere = MeshSphere(Base=volume.Centroid, Radius=10, UCount=10, VCount=20)  # disabled
item_2 = ListItem(List=rev_2, Index=0, Wrap=True)  # disabled
offmsh = OffsetMesh(Mesh=item_2, Distance=expr("x", panel_4), BothSides=0, CreateSolid=True)  # disabled
offmsh_2 = OffsetMesh(Mesh=offmsh, Distance=expr("-x", addition), BothSides=0, CreateSolid=True)  # disabled
multiplication = Multiplication()  # disabled
vmesh_3 = MeshToVolume(Mesh=item, Settings=vsettings_4)
minc = MeshInclusion(Mesh=voffset_2, Point=area_2.Centroid, Strict=False)  # disabled
facen = FaceNormals(Mesh=msphere)  # -> Centers, Normals; disabled
exposure = Exposure(Shape=mesh_6, Rays=facen.Normals, Lambert=False)  # -> Exposure, Range; disabled
mcol = MeshColours(Mesh=mesh_6, Colours=flatten(exposure.Exposure))  # disabled
voffset_3 = OffsetVolume(Volume=vmesh_3, Distance=expr("-x", mm_3))
addition_2 = Addition(A=larger.LargerThan, B=larger_3.LargerThan)  # disabled
panel_6 = Panel(addition_2)  # disabled
addition_3 = Addition(A=mm_3, B=mm_2)
meshcp = MeshClosestPoint(Point=area_2.Centroid, Mesh=mesh_3)  # -> Point, Index, Parameter; disabled
dist = Distance(PointA=area_2.Centroid, PointB=meshcp.Point)  # disabled
panel_7 = Panel("0.3")  # disabled
cull = CullPattern(List=area_2.Centroid, CullPattern=invert(minc))  # disabled
voffset_4 = OffsetVolume(Volume=voffset_3, Distance=addition_3)
panel_8 = Panel(exposure.Exposure)  # disabled
larger_4 = LargerThan(FirstNumber=dist, SecondNumber=panel_7)  # -> LargerThan, OrEqualTo; disabled
area_4 = Area(Geometry=explode)  # -> Area, Centroid
cull_2 = CullPattern(List=mesh_5, CullPattern=invert(flatten(addition_2)))  # disabled
cull_3 = CullPattern(List=mesh_3, CullPattern=invert(minc))  # disabled
cull_4 = CullPattern(List=mesh_3, CullPattern=minc)  # disabled
minc_2 = MeshInclusion(Mesh=voffset_4, Point=area_4.Centroid, Strict=False)
area_5 = Area(Geometry=cull_3)  # -> Area, Centroid; disabled
meshcp_2 = MeshClosestPoint(Point=area_5.Centroid, Mesh=mesh_3)  # -> Point, Index, Parameter; disabled
panel_9 = Panel("green")  # disabled
panel_10 = Panel("red")  # disabled
cull_5 = CullPattern(List=explode, CullPattern=invert(minc_2))
cull_6 = CullPattern(List=explode, CullPattern=minc_2)
dist_2 = Distance(PointA=area_2.Centroid, PointB=meshcp_2.Point)  # disabled
preview = CustomPreview(Geometry=cull_4, Material=panel_9)  # disabled
preview_2 = CustomPreview(Geometry=cull_3, Material=panel_10)  # disabled
panel_11 = Panel("0.3")  # disabled
larger_5 = LargerThan(FirstNumber=dist_2, SecondNumber=panel_11)  # -> LargerThan, OrEqualTo; disabled
cull_7 = CullPattern(List=cull_3, CullPattern=larger_5.LargerThan)  # disabled
