# Grasshopper definition GH_MeshOffset_02_PF.gh (Grasshopper 1.0.7)
# plug-ins: Speckle 2, DendroGH, Pufferfish, Pancake

mesh = Mesh([<mesh referenced from the Rhino model> x1803])
mm = Panel("1")
explode = ExplodeObject(Object=mesh, Recursive=False)
send = Send(AutoSend=False, CurrentComponentState="needs_input", KitName="Objects", UseDefaultCache=True, selectedKitName="Objects")  # disabled
mm_2 = Panel("0.1")
wrap = ShrinkWrap(Geometry=mesh, EdgeLength=mm, Offset=0, Smoothing=0, Optimization=10, FillHoles=True)
pcimportobj = ImportOBJ(File="C:\Users\PFC\viktor-apps\viktor-grasshopper\input.obj", MapYtoZ=Button(), LastSaveLocalization="neutral,N")
vsettings = CreateSettings(VoxelSize=0.1, Bandwidth=0.1, Isovalue=0, Adaptivity=0.1)  # disabled
volume = Volume(mesh)  # disabled
wrap_2 = ShrinkWrap(Geometry=mesh, EdgeLength=mm_2, Offset=0, Smoothing=0, Optimization=10, FillHoles=True)
receive = Receive(
    Stream=<missing>,
    AutoReceive=False,
    CurrentComponentState="expired",
    ExpandOutput=True,
    ReceiveOnOpen=False,
    StreamWrapper="https://speckle.xyz/streams/724b722d6e",
    selectedKitName="Objects")  # -> Info, Data; disabled
mesh_2 = Mesh(<mesh referenced from the Rhino model>)  # disabled
mesh_3 = Mesh([<mesh referenced from the Rhino model> x1774])  # disabled
mesh_4 = Mesh([<mesh referenced from the Rhino model> x1199])  # disabled
vsettings_2 = CreateSettings(VoxelSize=1, Bandwidth=1, Isovalue=0, Adaptivity=0.1)  # disabled
medges = MeshEdges(Mesh=mesh_2)  # -> NakedEdges, InteriorEdges, NonManifoldEdges; disabled
mesh_5 = Mesh([<mesh referenced from the Rhino model> x1199])  # disabled
panel = Panel("0.2")  # disabled
disjoint = DisjointMesh(Mesh=wrap_2)
vmesh = MeshToVolume(Mesh=mesh, Settings=vsettings)  # disabled
medges_2 = MeshEdges(Mesh=wrap_2)  # -> NakedEdges, InteriorEdges, NonManifoldEdges
panel_2 = Panel("https://speckle.xyz/streams/724b722d6e")  # disabled
capex = CapHolesEx(Brep=mesh_4)  # -> Brep, Caps, Solid; disabled
voffset = OffsetVolume(Volume=vmesh, Distance=panel)  # disabled
panel_3 = Panel("0.1")  # disabled
vsettings_3 = VolumeSettings()  # disabled
crv = Curve(medges.NakedEdges)  # disabled
medges_3 = MeshEdges(Mesh=mesh_5)  # -> NakedEdges, InteriorEdges, NonManifoldEdges; disabled
area = Area(Geometry=disjoint)  # -> Area, Centroid
area_2 = Area(Geometry=mesh_3)  # -> Area, Centroid; disabled
vunion = VolumeUnion(Volumes=voffset)  # disabled
panel_4 = Panel("0")  # disabled
wrap_3 = ShrinkWrap(Geometry=mesh_2, EdgeLength=panel_3, Offset=0, Smoothing=0, Optimization=10, FillHoles=True)  # disabled
vsettings_4 = CreateSettings(VoxelSize=0.2, Bandwidth=1, Isovalue=0, Adaptivity=0.1)  # disabled
mesh_6 = Mesh([<mesh referenced from the Rhino model> x5])  # disabled
sort = SortList(Keys=area.Area, ValuesA=disjoint)  # -> Keys, ValuesA
disjoint_2 = DisjointMesh(Mesh=wrap_3)  # disabled
panel_5 = Panel("0.5")  # disabled
preview = CustomPreview(Geometry=medges_2.InteriorEdges, Material=ColourSwatch(SwatchColor=RGBA(0, 0, 0, 231)))
panel_6 = Panel("0.6")  # disabled
lng = ListLength(List=medges_3.NonManifoldEdges)  # disabled
lng_2 = ListLength(List=medges_3.NakedEdges)  # disabled
rev = ReverseList(List=sort.ValuesA)
lng_3 = ListLength(List=medges_3.InteriorEdges)  # disabled
bbox = BoundingBox(Content=mesh_6, Plane=PlaneXY(0, 0, 0), UnionBox=True)  # -> Box, Box_2; disabled
area_3 = Area(Geometry=disjoint_2)  # -> Area, Centroid; disabled
vmesh_2 = MeshToVolume(Mesh=wrap_3, Settings=vsettings_4)  # disabled
item = ListItem(List=rev, Index=0, Wrap=True)
vmesh_3 = MeshToVolume(Mesh=mesh_5, Settings=vsettings_2)  # disabled
volume_2 = Volume(Geometry=bbox.Box)  # -> Volume, Centroid; disabled
voffset_2 = OffsetVolume(Volume=vmesh_2, Distance=expr("-x", panel_5))  # disabled
sort_2 = SortList(Keys=area_3.Area, ValuesA=disjoint_2)  # -> Keys, ValuesA; disabled
larger = LargerThan(FirstNumber=lng_2, SecondNumber=panel_4)  # -> LargerThan, OrEqualTo; disabled
larger_2 = LargerThan(FirstNumber=lng_3, SecondNumber=panel_4)  # -> LargerThan, OrEqualTo; disabled
larger_3 = LargerThan(FirstNumber=lng, SecondNumber=panel_4)  # -> LargerThan, OrEqualTo; disabled
addition = Addition(A=panel_5, B=panel_6)  # disabled
vunion_2 = VolumeUnion(Volumes=vmesh_3)  # disabled
vsettings_5 = CreateSettings(VoxelSize=0.2, Bandwidth=1, Isovalue=0, Adaptivity=0.1)
rev_2 = ReverseList(List=sort_2.ValuesA)  # disabled
mm_3 = Panel(".6")
mm_4 = Panel(".5")
voffset_3 = OffsetVolume(Volume=voffset_2, Distance=addition)  # disabled
msphere = MeshSphere(Base=volume_2.Centroid, Radius=10, UCount=10, VCount=20)  # disabled
item_2 = ListItem(List=rev_2, Index=0, Wrap=True)  # disabled
offmsh = OffsetMesh(Mesh=item_2, Distance=expr("x", panel_5), BothSides=0, CreateSolid=True)  # disabled
offmsh_2 = OffsetMesh(Mesh=offmsh, Distance=expr("-x", addition), BothSides=0, CreateSolid=True)  # disabled
multiplication = Multiplication()  # disabled
vmesh_4 = MeshToVolume(Mesh=item, Settings=vsettings_5)
minc = MeshInclusion(Mesh=voffset_3, Point=area_2.Centroid, Strict=False)  # disabled
facen = FaceNormals(Mesh=msphere)  # -> Centers, Normals; disabled
exposure = Exposure(Shape=mesh_6, Rays=facen.Normals, Lambert=False)  # -> Exposure, Range; disabled
mcol = MeshColours(Mesh=mesh_6, Colours=flatten(exposure.Exposure))  # disabled
voffset_4 = OffsetVolume(Volume=vmesh_4, Distance=expr("-x", mm_4))
addition_2 = Addition(A=larger.LargerThan, B=larger_3.LargerThan)  # disabled
panel_7 = Panel(addition_2)  # disabled
addition_3 = Addition(A=mm_4, B=mm_3)
meshcp = MeshClosestPoint(Point=area_2.Centroid, Mesh=mesh_3)  # -> Point, Index, Parameter; disabled
dist = Distance(PointA=area_2.Centroid, PointB=meshcp.Point)  # disabled
panel_8 = Panel("0.3")  # disabled
cull = CullPattern(List=area_2.Centroid, CullPattern=invert(minc))  # disabled
voffset_5 = OffsetVolume(Volume=voffset_4, Distance=addition_3)
panel_9 = Panel(exposure.Exposure)  # disabled
larger_4 = LargerThan(FirstNumber=dist, SecondNumber=panel_8)  # -> LargerThan, OrEqualTo; disabled
area_4 = Area(Geometry=explode)  # -> Area, Centroid
cull_2 = CullPattern(List=mesh_5, CullPattern=invert(flatten(addition_2)))  # disabled
preview_2 = CustomPreview(Geometry=voffset_5, Material=ColourSwatch(SwatchColor=RGBA(255, 0, 0, 74)))
cull_3 = CullPattern(List=mesh_3, CullPattern=invert(minc))  # disabled
cull_4 = CullPattern(List=mesh_3, CullPattern=minc)  # disabled
minc_2 = MeshInclusion(Mesh=voffset_5, Point=area_4.Centroid, Strict=False)
area_5 = Area(Geometry=cull_3)  # -> Area, Centroid; disabled
cull_5 = CullPattern(List=area_4.Centroid, CullPattern=invert(minc_2))
panel_10 = Panel(explode)
meshcp_2 = MeshClosestPoint(Point=area_5.Centroid, Mesh=mesh_3)  # -> Point, Index, Parameter; disabled
panel_11 = Panel("green")  # disabled
cull_6 = CullPattern(List=area_4.Centroid, CullPattern=minc_2)
panel_12 = Panel("red")  # disabled
cull_7 = CullPattern(List=explode, CullPattern=invert(minc_2))
medges_4 = MeshEdges(Mesh=cull_7)  # -> NakedEdges, InteriorEdges, NonManifoldEdges
cull_8 = CullPattern(List=explode, CullPattern=minc_2)
dist_2 = Distance(PointA=area_2.Centroid, PointB=meshcp_2.Point)  # disabled
preview_3 = CustomPreview(Geometry=cull_4, Material=panel_11)  # disabled
preview_4 = CustomPreview(Geometry=cull_3, Material=panel_12)  # disabled
panel_13 = Panel("0.3")  # disabled
preview_5 = CustomPreview(Geometry=medges_4.InteriorEdges, Material=ColourSwatch(SwatchColor=RGBA(0, 0, 0, 231)))
larger_5 = LargerThan(FirstNumber=dist_2, SecondNumber=panel_13)  # -> LargerThan, OrEqualTo; disabled
preview_6 = CustomPreview(Geometry=cull_5, Material=ColourSwatch(SwatchColor=RGBA(0, 255, 8, 231)))
cull_9 = CullPattern(List=cull_3, CullPattern=larger_5.LargerThan)  # disabled
swatch = ColourSwatch(SwatchColor=RGBA(255, 0, 0, 231))
preview_7 = CustomPreview(Geometry=cull_8, Material=swatch)  # disabled
preview_8 = CustomPreview(Geometry=cull_7, Material=swatch)
pcattribute = Attribute(
    Color=ColourSwatch(SwatchColor=RGBA(0, 255, 51, 100)),
    CurrentInputVisibility=0,
    CurrentOutputVisibility=0,
    LastSaveLocalization="neutral,N")
pcattribute_2 = Attribute(Color=swatch, CurrentInputVisibility=0, CurrentOutputVisibility=0, LastSaveLocalization="neutral,N")
lng_4 = ListLength(List=flatten(cull_8))
lng_5 = ListLength(List=flatten(cull_7))
truebutton = TrueOnlyButton(LastSaveLocalization="neutral,N")
repeat = RepeatData(Data=pcattribute_2, Length=lng_4)
repeat_2 = RepeatData(Data=pcattribute, Length=lng_5)
merge = Merge(Data1=flatten(cull_7), Data2=flatten(cull_8))
merge_2 = Merge(Data1=flatten(repeat_2), Data2=flatten(repeat))
pcexport3dm = Export3DM(
    Geometry=merge,
    Layer="Default",
    ObjectAttributes=merge_2,
    FileLocation="C:\Users\PFC\viktor-apps\viktor-grasshopper\output.3dm",
    Overwrite=Toggle(True),
    Version=0,
    Export=Button(),
    LastSaveLocalization="neutral,N")  # -> OK, Log
