# Grasshopper definition GH_MeshOffset_PF.gh (Grasshopper 1.0.7)
# plug-ins: Speckle 2, DendroGH, Pufferfish

mesh = Mesh(<mesh referenced from the Rhino model>)
mesh_2 = Mesh([<mesh referenced from the Rhino model> x1774])
mesh_3 = Mesh([<mesh referenced from the Rhino model> x1199])
vsettings = CreateSettings(VoxelSize=1, Bandwidth=1, Isovalue=0, Adaptivity=0.1)  # disabled
medges = MeshEdges(Mesh=mesh)  # -> NakedEdges, InteriorEdges, NonManifoldEdges
mesh_4 = Mesh([<mesh referenced from the Rhino model> x1199])  # disabled
mesh_5 = Mesh([<mesh referenced from the Rhino model> x1774])
mesh_6 = Mesh([<mesh referenced from the Rhino model> x1802])
panel = Panel("https://speckle.xyz/streams/724b722d6e")  # disabled
capex = CapHolesEx(Brep=mesh_3)  # -> Brep, Caps, Solid
explode = ExplodeObject(Object=mesh_6, Recursive=False)
vsettings_2 = VolumeSettings()  # disabled
crv = Curve(medges.NakedEdges)
medges_2 = MeshEdges(Mesh=mesh_4)  # -> NakedEdges, InteriorEdges, NonManifoldEdges; disabled
area = Area(Geometry=mesh_2)  # -> Area, Centroid
panel_2 = Panel("0")  # disabled
wrap = ShrinkWrap(Geometry=mesh, EdgeLength="0.1", Offset=0, Smoothing=0, Optimization=10, FillHoles=True)
vsettings_3 = CreateSettings(VoxelSize=0.2, Bandwidth=1, Isovalue=0, Adaptivity=0.1)
mesh_7 = Mesh([<mesh referenced from the Rhino model> x5])
disjoint = DisjointMesh(Mesh=wrap)
send = Send(AutoSend=False, CurrentComponentState="needs_input", KitName="Objects", UseDefaultCache=True, selectedKitName="Objects")  # disabled
lng = ListLength(List=medges_2.NonManifoldEdges)  # disabled
lng_2 = ListLength(List=medges_2.NakedEdges)  # disabled
lng_3 = ListLength(List=medges_2.InteriorEdges)  # disabled
bbox = BoundingBox(Content=mesh_7, Plane=PlaneXY(0, 0, 0), UnionBox=True)  # -> Box, Box_2
wrap_2 = ShrinkWrap(Geometry=mesh_6, EdgeLength="0.1", Offset=0, Smoothing=0, Optimization=10, FillHoles=True)
area_2 = Area(Geometry=disjoint)  # -> Area, Centroid
vmesh = MeshToVolume(Mesh=wrap, Settings=vsettings_3)
receive = Receive(
    Stream=<missing>,
    AutoReceive=False,
    CurrentComponentState="expired",
    ExpandOutput=True,
    ReceiveOnOpen=False,
    StreamWrapper="https://speckle.xyz/streams/724b722d6e",
    selectedKitName="Objects")  # -> Info, Data; disabled
vmesh_2 = MeshToVolume(Mesh=mesh_4, Settings=vsettings)  # disabled
disjoint_2 = DisjointMesh(Mesh=wrap_2)
volume = Volume(Geometry=bbox.Box)  # -> Volume, Centroid
voffset = OffsetVolume(Volume=vmesh, Distance=expr("-x", "0.5"))
sort = SortList(Keys=area_2.Area, ValuesA=disjoint)  # -> Keys, ValuesA
vsettings_4 = CreateSettings(VoxelSize=0.2, Bandwidth=1, Isovalue=0, Adaptivity=0.1)
larger = LargerThan(FirstNumber=lng_2, SecondNumber=panel_2)  # -> LargerThan, OrEqualTo; disabled
larger_2 = LargerThan(FirstNumber=lng_3, SecondNumber=panel_2)  # -> LargerThan, OrEqualTo; disabled
larger_3 = LargerThan(FirstNumber=lng, SecondNumber=panel_2)  # -> LargerThan, OrEqualTo; disabled
addition = Addition(A="0.5", B="0.6")
vunion = VolumeUnion(Volumes=vmesh_2)  # disabled
area_3 = Area(Geometry=disjoint_2)  # -> Area, Centroid
rev = ReverseList(List=sort.ValuesA)
voffset_2 = OffsetVolume(Volume=voffset, Distance=addition)
msphere = MeshSphere(Base=volume.Centroid, Radius=10, UCount=10, VCount=20)
sort_2 = SortList(Keys=area_3.Area, ValuesA=disjoint_2)  # -> Keys, ValuesA
item = ListItem(List=rev, Index=0, Wrap=True)
offmsh = OffsetMesh(Mesh=item, Distance=expr("x", "0.5"), BothSides=0, CreateSolid=True)
offmsh_2 = OffsetMesh(Mesh=offmsh, Distance=expr("-x", addition), BothSides=0, CreateSolid=True)
multiplication = Multiplication()  # disabled
rev_2 = ReverseList(List=sort_2.ValuesA)
minc = MeshInclusion(Mesh=voffset_2, Point=area.Centroid, Strict=False)
facen = FaceNormals(Mesh=msphere)  # -> Centers, Normals
exposure = Exposure(Shape=mesh_7, Rays=facen.Normals, Lambert=False)  # -> Exposure, Range
mcol = MeshColours(Mesh=mesh_7, Colours=flatten(exposure.Exposure))
addition_2 = Addition(A=larger.LargerThan, B=larger_3.LargerThan)  # disabled
item_2 = ListItem(List=rev_2, Index=0, Wrap=True)
vmesh_3 = MeshToVolume(Mesh=item_2, Settings=vsettings_4)
voffset_3 = OffsetVolume(Volume=vmesh_3, Distance=expr("-x", "0.5"))
panel_3 = Panel(addition_2)  # disabled
meshcp = MeshClosestPoint(Point=area.Centroid, Mesh=mesh_2)  # -> Point, Index, Parameter
dist = Distance(PointA=area.Centroid, PointB=meshcp.Point)
voffset_4 = OffsetVolume(Volume=voffset_3, Distance=addition)
cull = CullPattern(List=area.Centroid, CullPattern=invert(minc))
panel_4 = Panel(exposure.Exposure)
area_4 = Area(Geometry=explode)  # -> Area, Centroid
larger_4 = LargerThan(FirstNumber=dist, SecondNumber="0.3")  # -> LargerThan, OrEqualTo
cull_2 = CullPattern(List=mesh_4, CullPattern=invert(flatten(addition_2)))  # disabled
cull_3 = CullPattern(List=mesh_2, CullPattern=invert(minc))
cull_4 = CullPattern(List=mesh_2, CullPattern=minc)
minc_2 = MeshInclusion(Mesh=voffset_4, Point=area_4.Centroid, Strict=False)
area_5 = Area(Geometry=cull_3)  # -> Area, Centroid
panel_5 = Panel(minc_2)
meshcp_2 = MeshClosestPoint(Point=area_5.Centroid, Mesh=mesh_2)  # -> Point, Index, Parameter
cull_5 = CullPattern(List=explode, CullPattern=invert(minc_2))
cull_6 = CullPattern(List=explode, CullPattern=minc_2)
dist_2 = Distance(PointA=area.Centroid, PointB=meshcp_2.Point)
preview = CustomPreview(Geometry=cull_4, Material="green")
preview_2 = CustomPreview(Geometry=cull_3, Material="red")
larger_5 = LargerThan(FirstNumber=dist_2, SecondNumber="0.3")  # -> LargerThan, OrEqualTo
cull_7 = CullPattern(List=cull_3, CullPattern=larger_5.LargerThan)
