# Grasshopper definition occlusion.gh (Grasshopper 1.0.7)

mesh = Mesh([<mesh referenced from the Rhino model> x1774])
bbox = BoundingBox(Content=mesh, Plane=PlaneXY(0, 0, 0), UnionBox=True)  # -> Box, Box_2
volume = Volume(Geometry=bbox.Box)  # -> Volume, Centroid
msphereex = MeshSphereEx(Base=volume.Centroid, Radius=100, Count=5)
facen = FaceNormals(Mesh=msphereex)  # -> Centers, Normals
exposure = Exposure(Shape=mesh, Rays=facen.Normals, Lambert=False)  # -> Exposure, Range
avr = Average(Input=exposure.Exposure)
bnd = Bounds(Numbers=exposure.Exposure)
panel = Panel(exposure.Exposure)
rgb = ColourRGB(Alpha=255, Red=avr, Green=0, Blue=0)
remap = RemapNumbers(Value=exposure.Exposure, Source=bnd, Target="0 to 1")  # -> Mapped, Clipped
bang = ExplodeTree(Data=exposure.Exposure)  # -> Branch0, Branch1
item = ListItem(List=mesh, Index=0, Wrap=True)
rgb_2 = ColourRGB(Alpha=255, Red=exposure.Exposure, Green=0, Blue=0)
frgb = ColourRGBF(Alpha=1, Red=remap.Mapped, Green=0, Blue=0)
mcol = MeshColours(Mesh=graft(mesh), Colours=rgb)
mcol_2 = MeshColours(Mesh=graft(mesh), Colours=frgb)
