# Grasshopper definition unnamed.gh (Grasshopper 1.0.7)
# plug-ins: Speckle 2, DendroGH, Pufferfish

mesh = Mesh([<mesh referenced from the Rhino model> x1774])
mesh_2 = Mesh([<mesh referenced from the Rhino model> x1199])
vsettings = CreateSettings(VoxelSize=1, Bandwidth=1, Isovalue=0, Adaptivity=0.1)  # disabled
mesh_3 = Mesh([<mesh referenced from the Rhino model> x1199])  # disabled
mesh_4 = Mesh(<mesh referenced from the Rhino model>)
medges = MeshEdges(Mesh=mesh_4)  # -> NakedEdges, InteriorEdges, NonManifoldEdges
panel = Panel("https://speckle.xyz/streams/724b722d6e")  # disabled
capex = CapHolesEx(Brep=mesh_2)  # -> Brep, Caps, Solid
vsettings_2 = VolumeSettings()  # disabled
crv = Curve(medges.NakedEdges)
medges_2 = MeshEdges(Mesh=mesh_3)  # -> NakedEdges, InteriorEdges, NonManifoldEdges; disabled
area = Area(Geometry=mesh)  # -> Area, Centroid
panel_2 = Panel("0")  # disabled
vsettings_3 = CreateSettings(VoxelSize=0.2, Bandwidth=1, Isovalue=0, Adaptivity=0.1)
wrap = ShrinkWrap(Geometry=mesh_4, EdgeLength="0.1", Offset=0, Smoothing=0, Optimization=10, FillHoles=True)
mesh_5 = Mesh([<mesh referenced from the Rhino model> x5])
disjoint = DisjointMesh(Mesh=wrap)
send = Send(AutoSend=False, CurrentComponentState="needs_input", KitName="Objects", UseDefaultCache=True, selectedKitName="Objects")  # disabled
lng = ListLength(List=medges_2.NonManifoldEdges)  # disabled
lng_2 = ListLength(List=medges_2.NakedEdges)  # disabled
lng_3 = ListLength(List=medges_2.InteriorEdges)  # disabled
bbox = BoundingBox(Content=mesh_5, Plane=PlaneXY(0, 0, 0), UnionBox=True)  # -> Box, Box_2
area_2 = Area(Geometry=disjoint)  # -> Area, Centroid
vmesh = MeshToVolume(Mesh=wrap, Settings=vsettings_3)
receive = Receive(
    Stream=<missing>,
    AutoReceive=False,
    CurrentComponentState="expired",
    ExpandOutput=True,
    ReceiveOnOpen=False,
    StreamWrapper="https://speckle.xyz/streams/724b722d6e",
    selectedKitName="Objects")  # -> Info, Data; disabled
vmesh_2 = MeshToVolume(Mesh=mesh_3, Settings=vsettings)  # disabled
volume = Volume(Geometry=bbox.Box)  # -> Volume, Centroid
voffset = OffsetVolume(Volume=vmesh, Distance=expr("-x", "0.5"))
sort = SortList(Keys=area_2.Area, ValuesA=disjoint)  # -> Keys, ValuesA
larger = LargerThan(FirstNumber=lng_2, SecondNumber=panel_2)  # -> LargerThan, OrEqualTo; disabled
larger_2 = LargerThan(FirstNumber=lng_3, SecondNumber=panel_2)  # -> LargerThan, OrEqualTo; disabled
larger_3 = LargerThan(FirstNumber=lng, SecondNumber=panel_2)  # -> LargerThan, OrEqualTo; disabled
addition = Addition(A="0.5", B="0.6")
vunion = VolumeUnion(Volumes=vmesh_2)  # disabled
rev = ReverseList(List=sort.ValuesA)
voffset_2 = OffsetVolume(Volume=voffset, Distance=addition)
msphere = MeshSphere(Base=volume.Centroid, Radius=10, UCount=10, VCount=20)
item = ListItem(List=rev, Index=0, Wrap=True)
offmsh = OffsetMesh(Mesh=item, Distance=expr("x", "0.5"), BothSides=0, CreateSolid=True)
offmsh_2 = OffsetMesh(Mesh=offmsh, Distance=expr("-x", addition), BothSides=0, CreateSolid=True)
multiplication = Multiplication()  # disabled
minc = MeshInclusion(Mesh=voffset_2, Point=area.Centroid, Strict=False)
facen = FaceNormals(Mesh=msphere)  # -> Centers, Normals
exposure = Exposure(Shape=mesh_5, Rays=facen.Normals, Lambert=False)  # -> Exposure, Range
mcol = MeshColours(Mesh=mesh_5, Colours=flatten(exposure.Exposure))
addition_2 = Addition(A=larger.LargerThan, B=larger_3.LargerThan)  # disabled
panel_3 = Panel(addition_2)  # disabled
meshcp = MeshClosestPoint(Point=area.Centroid, Mesh=mesh)  # -> Point, Index, Parameter
dist = Distance(PointA=area.Centroid, PointB=meshcp.Point)
cull = CullPattern(List=area.Centroid, CullPattern=invert(minc))
panel_4 = Panel(exposure.Exposure)
larger_4 = LargerThan(FirstNumber=dist, SecondNumber="0.3")  # -> LargerThan, OrEqualTo
cull_2 = CullPattern(List=mesh_3, CullPattern=invert(flatten(addition_2)))  # disabled
cull_3 = CullPattern(List=mesh, CullPattern=invert(minc))
cull_4 = CullPattern(List=mesh, CullPattern=minc)
area_3 = Area(Geometry=cull_3)  # -> Area, Centroid
meshcp_2 = MeshClosestPoint(Point=area_3.Centroid, Mesh=mesh)  # -> Point, Index, Parameter
dist_2 = Distance(PointA=area.Centroid, PointB=meshcp_2.Point)
preview = CustomPreview(Geometry=cull_4, Material="green")
preview_2 = CustomPreview(Geometry=cull_3, Material="red")
larger_5 = LargerThan(FirstNumber=dist_2, SecondNumber="0.3")  # -> LargerThan, OrEqualTo
cull_5 = CullPattern(List=cull_3, CullPattern=larger_5.LargerThan)
